# Grasshopper definition HeathGH.gh (Grasshopper 1.0.8)

file_path = FilePath()
file_path_2 = FilePath()
loadobjects = HBLoadObjects(hb_file=file_path_2, load=Toggle(True))  # -> out, hb_objs; plug-in component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
python_3_script = Python3Script(x=file_path)  # -> out, breps, ids, names, descriptions, footprint_areas, gross_floor_areas, floors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
# ---------- python_3_script: Python ----------
import json
import Rhino.Geometry as rg

# 1. Load the JSON data
with open(x, "r", encoding="utf-8") as f:
    data = json.load(f)

buildings = data.get("buildings", [])

# 2. Initialize output lists (One entry PER FLOOR / ZONE)
out_breps = []
out_ids = []
out_names = []
out_descriptions = []
out_footprint_areas = []
out_floor_heights = []
out_colors = []
out_wwrs = []
out_overhangs = []
out_overhang_depths = []
out_wall_constructions = []
out_floor_constructions = []
out_roof_constructions = []
out_window_constructions = []
out_structural_systems = []
out_building_programs = []
out_hvac_systems = []
out_natural_ventilations = []

# 3. Loop through each building and create floors
for b in buildings:
    floors = b.get("floors", 1)
    floor_height = b.get("floorHeight", 3.0)
    
    # Extract base coordinates (Mapping Web Y-up to Rhino Z-up)
    coordinates = b.get("points", [])
    points = []
    for c in coordinates:
        pt = rg.Point3d(c["x"], c["z"], c["y"])
        points.append(pt)
    
    if len(points) > 2:
        # Close the polyline
        points.append(points[0])
        polyline = rg.Polyline(points)
        curve = polyline.ToNurbsCurve()
        
        # Extrude the curve vertically by just ONE floor height
        base_extrusion = rg.Extrusion.Create(curve, floor_height, True)
        
        if base_extrusion:
            base_brep = base_extrusion.ToBrep()
            
            # Multiply and stack the floor Brep
            for i in range(floors):
                # Duplicate the base Brep for this specific floor
                floor_brep = base_brep.Duplicate()
                
                # Move the Brep up based on the floor index
                z_translation = i * floor_height
                if z_translation > 0:
                    translation_vector = rg.Transform.Translation(0, 0, z_translation)
                    floor_brep.Transform(translation_vector)
                
                out_breps.append(floor_brep)
                
                # --- Map Metadata for THIS specific floor ---
                base_id = b.get("id", "bldg")
                base_name = b.get("name", "Building")
                
                # Give each floor a unique ID and Name for Honeybee
                out_ids.append("{}_fl_{}".format(base_id, i))
                out_names.append("{} - Floor {}".format(base_name, i))
                
                # Duplicate the shared building params for this floor
                out_descriptions.append(b.get("description"))
                out_footprint_areas.append(b.get("footprintArea"))
                out_floor_heights.append(floor_height)
                out_colors.append(b.get("color"))
                out_wwrs.append(b.get("window_to_wall_ratio"))
                out_overhangs.append(b.get("window_overhang"))
                out_overhang_depths.append(b.get("window_overhang_depth"))
                out_wall_constructions.append(b.get("wall_construction"))
                out_floor_constructions.append(b.get("floor_construction"))
                out_roof_constructions.append(b.get("roof_construction"))
                out_window_constructions.append(b.get("window_construction"))
                out_structural_systems.append(b.get("structural_system"))
                out_building_programs.append(b.get("building_program"))
                out_hvac_systems.append(b.get("hvac_system"))
                out_natural_ventilations.append(b.get("natural_ventilation"))

# 4. Assign to Grasshopper output variables
breps = out_breps
ids = out_ids
names = out_names
descriptions = out_descriptions
footprint_areas = out_footprint_areas
floor_heights = out_floor_heights
colors = out_colors
wwrs = out_wwrs
overhangs = out_overhangs
overhang_depths = out_overhang_depths
wall_constructions = out_wall_constructions
floor_constructions = out_floor_constructions
roof_constructions = out_roof_constructions
window_constructions = out_window_constructions
structural_systems = out_structural_systems
building_programs = out_building_programs
hvac_systems = out_hvac_systems
natural_ventilations = out_natural_ventilations
# ---------- end python_3_script ----------
vizbytype = HBVisualizeByType(hb_objs=loadobjects.hb_objs)  # -> walls, interior_walls, roofs, ceilings, exterior_floors, interior_floors, air_walls, apertures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; plug-in component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
constructionset = HBConstructionSet()  # -> constr_set; plug-in component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
boolean_toggle = BooleanToggle(True)
roomsolid = HBRoomFromSolid(geo=flatten(python_3_script.breps), name=python_3_script.names, constr_set=constructionset, conditioned=True)  # -> out, rooms; plug-in component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
intsolid = HBIntersectSolids(rooms=flatten(roomsolid.rooms), run=boolean_toggle)  # -> int_rooms; plug-in component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
solveadj = HBSolveAdjacency(rooms=flatten(intsolid), run=boolean_toggle)  # -> out, adj_rooms; plug-in component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
aperturesbywh = HBAperturesByWidthHeight(hb_objs=flatten(solveadj.adj_rooms), win_height=Slider(1.5, range=0..10), sill_height=Slider(0.9, range=0..1))  # -> out, hb_objs; plug-in component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
bordershades = HBExtrudedBorderShades(hb_objs=flatten(aperturesbywh.hb_objs), depth="0.3")  # -> out, hb_objs; plug-in component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
vizbytype_2 = HBVisualizeByType(hb_objs=bordershades.hb_objs)  # -> walls, interior_walls, roofs, ceilings, exterior_floors, interior_floors, air_walls, apertures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; plug-in component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
